# Grasshopper definition M6U1&U2_Group Assignment.gh (Grasshopper 1.0.8)

num_floors = Slider(25, range=5..50)
setback = Slider(25, range=0..50)
floor_height = Slider(4, range=3..5)
indices = Series(Start=1, Step=1, Count=num_floors)
default_plot_200x200 = Rectangle(Plane=PlaneXY(0, 0, 0), XSize=Domain(0, 200), YSize=Domain(0, 200), Radius=0)  # -> Rectangle, Length
inward_offset = Negative(Value=setback)
level_names = Format(Format="L{0:00}", Culture=127, Data0=indices)
plot_boundary = Curve(default_plot_200x200.Rectangle)
floor_elevations = Series(Start=0, Step=floor_height, Count=num_floors)
plot_area = Area(Geometry=plot_boundary)  # -> Area, Centroid
total_height = Multiplication(A=num_floors, B=floor_height)
footprint_offset = OffsetCurve(Curve=plot_boundary, Distance=inward_offset, Corners=1)
panel = Panel(level_names)
col_spacing = Slider(6, range=4..10)
length = Length(Curve=footprint_offset)
unit_z = UnitZ(Factor=floor_elevations)
spacing_calc = Division(A=length, B=col_spacing)
footprint_area = Area(Geometry=footprint_offset)  # -> Area, Centroid
top_vector = UnitZ(Factor=total_height)
move_to_floors = Move(Geometry=footprint_offset, Motion=unit_z)  # -> Geometry, Transform
column_base_points = DivideCurve(Curve=footprint_offset, Count=spacing_calc, Kinks=False)  # -> Points, Tangents, Parameters
_60_plot_area = Multiplication(A=plot_area.Area, B=0.6)
floor_plates = BoundarySurfaces(Edges=flatten(move_to_floors.Geometry))
concrete_swatch = ColourSwatch(SwatchColor=RGB(204, 204, 204))
area_check = SmallerThan(FirstNumber=footprint_area.Area, SecondNumber=_60_plot_area)  # -> SmallerThan, OrEqualTo
column_top_points = Move(Geometry=column_base_points.Points, Motion=top_vector)  # -> Geometry, Transform
floor_area_calc = Area(Geometry=floor_plates)  # -> Area, Centroid
floor_preview = CustomPreview(Geometry=floor_plates, Material=concrete_swatch)
facade = Loft(
    Curves=flatten(move_to_floors.Geometry),
    Options={Adjust=False, Closed=False, LoftEnds=0, LoftSimp=0, LoftType=0, Rebuild=10, Refit=0.01})
total_floor_area_sum = MassAddition(Input=floor_area_calc.Area)  # -> Result, PartialResults
steel_swatch = ColourSwatch(SwatchColor=RGB(76, 76, 76))
column_lines = Line(StartPoint=column_base_points.Points, EndPoint=column_top_points.Geometry)
facade_area_calc = Area(Geometry=facade)  # -> Area, Centroid
glass_material = CreateMaterial(
    Diffuse=RGBA(0, 0, 0, 0),
    Specular=RGB(255, 255, 255),
    Emission=RGB(0, 0, 0),
    Transparency=Slider(0.43, range=0..1),
    Shine=0)
facade_preview = CustomPreview(Geometry=facade, Material=glass_material)
floor_count = ListLength(List=floor_plates)
column_preview = CustomPreview(Geometry=column_lines, Material=steel_swatch)
facade_sum = MassAddition(Input=facade_area_calc.Area)  # -> Result, PartialResults
column_count = ListLength(List=column_lines)
label_facade = Concatenate(FragmentB=facade_sum.Result)
label_floor_count = Concatenate(FragmentB=floor_count)
label_floor_area = Concatenate(FragmentA="Total Floor Area: 99", FragmentB=total_floor_area_sum.Result)
label_column_count = Concatenate(FragmentB=column_count)
total_facade_area = Panel(label_facade)
floor_area_display = Panel(label_floor_area)
total_number_of_floors = Panel(label_floor_count)
total_number_of_columns = Panel(label_column_count)
area_pass60 = Panel(area_check.SmallerThan)
footprint_area_2 = Panel(_60_plot_area)
